# Grasshopper definition script.gh (Grasshopper 1.0.7)

# ----
# Inputs from Rhino Compute
number_slider = Slider(0.74, range=0.2..1)
# Tower Parameters
# Floor Plan length
floorplan_width = GetInteger(Slider(15, range=10..18), AtLeast=1, AtMost=1, Maximum=2147483647, Minimum=-2147483648, TreeAccess=False)
# Rotation Angle
tower_height = GetInteger(Slider(31, range=20..100), AtLeast=1, AtMost=1, Maximum=2147483647, Minimum=-2147483648, TreeAccess=False)
# Floor Height
twist_top = GetNumber(number_slider, AtLeast=1, AtMost=1, Maximum=1.797693135e+308, Minimum=-1.797693135e+308, TreeAccess=False)
# Tower Height
floor_height = GetNumber(Slider(3.7, range=2.5..5), AtLeast=1, AtMost=1, Maximum=1.797693135e+308, Minimum=-1.797693135e+308, TreeAccess=False)
rotation = GetInteger(Slider(52, range=0..90), AtLeast=1, AtMost=1, Maximum=2147483647, Minimum=-2147483648, TreeAccess=False)
month = GetInteger(Slider(6, range=1..12), AtLeast=1, AtMost=1, Maximum=2147483647, Minimum=-2147483648, TreeAccess=False)
day = GetInteger(Slider(21, range=1..31), AtLeast=1, AtMost=1, Maximum=2147483647, Minimum=-2147483648, TreeAccess=False)

# ----
# Import Location from EPW File
panel = Panel("https://energyplus-weather.s3.amazonaws.com/europe_wmo_region_6/NLD/NLD_Amsterdam.062400_IWEC/NLD_Amsterdam.062400_IWEC.zip")
downloadepw = LBDownloadWeather(weather_URL=panel)  # -> epw_file, stat_file, ddy_file; plug-in component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
downloadepw_2 = LBDownloadWeather(weather_URL=panel)  # -> epw_file, stat_file, ddy_file; plug-in component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
importepw = LBImportEPW(epw_file=downloadepw.epw_file)  # -> location, dry_bulb_temperature, dew_point_temperature, relative_humidity, wind_speed, wind_direction, direct_normal_rad, diffuse_horizontal_rad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; plug-in component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
importloc = LBImportLocation(epw_file=downloadepw_2.epw_file)  # -> location; plug-in component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

# ----
# Analysis Period for
# Summer Solstice
number_slider_2 = Slider(6, range=0..10)
analysisperiod = LBAnalysisPeriod(
    start_month=month,
    start_day=day,
    start_hour=number_slider_2,
    end_month=month,
    end_day=day,
    end_hour=Slider(18, range=0..100),
    timestep="1")  # -> period, hoys, dates; plug-in component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

# ----
# Create tower
# Floor Area
# Total Gross Area
# Twist End
construct_domain = ConstructDomain(DomainStart=expr("-0.5*x", floorplan_width), DomainEnd=expr("0.5*x", floorplan_width))
rectangle = Rectangle(Plane=PlaneXY(0, 0, 0), XSize=construct_domain, YSize=construct_domain, Radius=0)  # -> Rectangle, Length
multiplication = Multiplication(A=twist_top, B=tower_height)
radians = Radians(Degrees=rotation)
unit_z = UnitZ(Factor=multiplication)
box_rectangle = BoxRectangle(Rectangle=rectangle.Rectangle, Height=tower_height)
area = Area(Geometry=rectangle.Rectangle)  # -> Area, Centroid
division = Division(A=tower_height, B=floor_height)
move = Move(Geometry=area.Centroid, Motion=unit_z)  # -> Geometry, Transform
line = Line(StartPoint=area.Centroid, EndPoint=move.Geometry)
round = Round(Number=division)  # -> Nearest, Floor, Ceiling
twist = Twist(Geometry=box_rectangle, Axis=line, Angle=radians, Infinite=False, Rigid=False)
panel_2 = Panel(area.Area)
multiplication_2 = Multiplication(A=panel_2, B=round.Floor)
panel_3 = Panel(multiplication_2)
gross_area = Integer(multiplication_2)
floor_area = Integer(area.Area)

# ----
# Create Sunpath
number_slider_3 = Slider(1, range=0..10)
sunpath = LBSunPath(north="20", location=importloc, hoys=analysisperiod.hoys, scale=number_slider_3, data=importepw.dry_bulb_temperature)  # -> report, vectors, altitudes, azimuths, hoys, sun_pts, analemma, daily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; plug-in component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

series = Series(Start=0, Step=1, Count=Slider(3, range=0..10))
series_2 = Series(Start=Slider(3, range=0..10), Step=1, Count=Slider(4, range=0..10))
series_3 = Series(Start=Slider(11, range=0..100), Step=1, Count=Slider(12, range=0..100))
series_4 = Series(Start=Slider(3, range=0..10), Step=1, Count=Slider(4, range=0..10))
series_5 = Series(Start=Slider(7, range=0..100), Step=1, Count=Slider(4, range=0..100))

# ---- group: Run Me!
# Run Analysis
boolean_toggle = BooleanToggle(True)

# ----
run_solar_analysis = GetBoolean(boolean_toggle, AtLeast=1, AtMost=1, FalseValue="False", TreeAccess=False, TrueValue="True")

# ----
# Run Direct Sun Study
# Context
# Analysis mesh
# Legend mesh
context = Brep(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)
triangulate = Triangulate(Mesh=twist)  # -> Mesh, Count
directsunhours = LBDirectSunHours(
    vectors=flatten(sunpath.vectors),
    timestep="1",
    geometry=graft([context, triangulate.Mesh]),
    context=flatten([context, triangulate.Mesh]),
    grid_size="5",
    offset_dist="0.5",
    run=run_solar_analysis)  # -> flatten(report), points, results, mesh, flatten(legend), title, int_mtx; plug-in component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
mesh = Mesh([twist, context])
average = Average(Input=directsunhours.results)
list_item = ListItem(List=directsunhours.legend, Index=0, Wrap=True)
mesh_2 = Mesh(list_item)
tree_branch = TreeBranch(Tree=simplify(average), Path="{1}", MaintainPaths=False)
tree_branch_2 = TreeBranch(Tree=simplify(average), Path="{0}", MaintainPaths=False)
mesh_join = MeshJoin(Meshes=flatten(mesh))
mesh_join_2 = MeshJoin(Meshes=flatten([directsunhours.mesh, mesh_2]))
avg_sun_hours_tower = Number(tree_branch)
avg_sun_hours_context = Number(tree_branch_2)

# ----
# Sun Dome
curve = Curve([sunpath.analemma, sunpath.daily])
# Compass circles
list_item_2 = ListItem(List=sunpath.compass, Index=series, Wrap=True)
# Compass lines
list_item_3 = ListItem(List=sunpath.compass, Index=[series_2, series_3], Wrap=True)
# Compass orientation locations
list_item_4 = ListItem(List=sunpath.compass, Index=series_4, Wrap=True)
# Compass orientations
list_item_5 = ListItem(List=sunpath.compass, Index=series_5, Wrap=False)
circle = Circle(list_item_2)
end_points = EndPoints(Curve=list_item_4)  # -> Start, End
data = Data(circle)
curve_2 = Curve(list_item_3)
curve_3 = Curve(data)
deconstruct_brep = DeconstructBrep(Brep=twist)  # -> Faces, Edges, Vertices
point = Point(end_points.End)
deconstruct_mesh = DeconstructMesh(Mesh=mesh_2)  # -> Vertices, Faces, Colours, Normals
construct_domain_2 = ConstructDomain(DomainStart=Slider(1, range=0..10), DomainEnd=Slider(12, range=0..100))
area_2 = Area(Geometry=twist)  # -> Area, Centroid
# Geometry outline
curve_4 = Curve(flatten(deconstruct_brep.Edges))
geometry = Geometry(flatten([curve, curve_2, curve_3]))
deconstruct = Deconstruct(Point=point)  # -> XComponent, YComponent, ZComponent
deconstruct_2 = Deconstruct(Point=point)  # -> XComponent, YComponent, ZComponent
# 0 : Normal tower
# 1 : Solar analysis
stream_filter = StreamFilter(Gate=run_solar_analysis, Stream0=flatten(mesh_join), Stream1=mesh_join_2)  # -> flatten(Stream)
# Legend mesh points
cull_duplicates = CullDuplicates(Points=deconstruct_mesh.Vertices, Tolerance=Slider(4, range=0..100), CullMode=3)  # -> Points, Indices, Valence
text = Text(flatten(list_item_5))
facade_area = Integer(area_2.Area)
deconstruct_3 = Deconstruct(Point=cull_duplicates.Points)  # -> flatten(XComponent), flatten(YComponent), ZComponent
# Legend mesh values
sub_list = SubList(List=directsunhours.legend, Domain=construct_domain_2, Wrap=True)  # -> flatten(List), Index
# 0 : Tower outline
# 1 : Sun dome
stream_filter_2 = StreamFilter(Gate=run_solar_analysis, Stream0=curve_4, Stream1=geometry)

# ----
# Outputs to Rhino Compute
context_print = ContextPrint(Avg_sun_hours_context=avg_sun_hours_context)
context_print_2 = ContextPrint(Avg_sun_hours_tower=avg_sun_hours_tower)
context_print_3 = ContextPrint(Compass_text=text)
context_print_4 = ContextPrint(Solar_values=sub_list.List)
context_print_5 = ContextPrint(Facade_area=facade_area)
context_bake = ContextBake(Geometry2=stream_filter_2)
context_print_6 = ContextPrint(Compass_x=deconstruct_2.XComponent)
context_print_7 = ContextPrint(Compass_y=deconstruct.YComponent)
context_print_8 = ContextPrint(Gross_area=gross_area)
context_print_9 = ContextPrint(Floor_area=floor_area)
context_bake_2 = ContextBake(Geometry=stream_filter)
context_print_10 = ContextPrint(Pointsy=deconstruct_3.YComponent)
context_print_11 = ContextPrint(Pointsx=deconstruct_3.XComponent)
